% Simulink data dictionary VCU_Modes.sldd

TRUE = Simulink.Parameter(1, StorageClass="Const", DataType="boolean")
FALSE = Simulink.Parameter(0, StorageClass="Const", DataType="boolean")
F32_ZERO = Simulink.Parameter(0, StorageClass="Const", DataType="single")
s_VCU_ModeStsVcu = Simulink.Signal(StorageClass="ExportedGlobal", DataType="Enum: VCU_MODE")  % VCU Mode Status When Power is ON
UI16_ZERO = Simulink.Parameter(0, StorageClass="Const", DataType="uint16")
UI8_ZERO = Simulink.Parameter(0, StorageClass="Const", DataType="uint8")
c_VCU_BattCurrDrvThd = Simulink.Parameter(100, StorageClass="ExportedGlobal", DataType="single", Min=0, Max=210, Unit="A")  % Maximum continuos battery current threshold for drive mode
c_VCU_BattCurrPeakDrvThd = Simulink.Parameter(180, StorageClass="ExportedGlobal", DataType="single", Min=0, Max=210, Unit="A")  % Maximum peak battery current threshold for drive mode
c_VCU_BattCurrParkThd = Simulink.Parameter(5, StorageClass="ExportedGlobal", DataType="single", Min=0, Max=10, Unit="A")  % Battery current threshold for park mode
c_VCU_BattTempParkThd = Simulink.Parameter(45, StorageClass="ExportedGlobal", DataType="single", Min=0, Max=60, Unit=" degC")  % Battery temperature threshold for park mode to drive mode disable
c_VCU_BattTempDrvThdMax = Simulink.Parameter(60, StorageClass="ExportedGlobal", DataType="single", Min=0, Max=100, Unit=" degC")  % Maximum Battery temperature threshold for drive mode to operate
c_VCU_MotTempParkThd = Simulink.Parameter(80, StorageClass="ExportedGlobal", DataType="single", Min=0, Max=100, Unit=" degC")  % Motor temperature threshold for park mode to drive mode disable
c_VCU_BattTempParkThdFlt = Simulink.Parameter(55, StorageClass="ExportedGlobal", DataType="single", Min=0, Max=60, Unit=" degC")  % Battery temperature threshold for park mode to Power off
c_VCU_MotTempParkThdFlt = Simulink.Parameter(100, StorageClass="ExportedGlobal", DataType="single", Min=0, Max=120, Unit=" degC")  % Motor temperature threshold for park mode to Power off
c_VCU_MotTempDrvThdMax = Simulink.Parameter(120, StorageClass="ExportedGlobal", DataType="single", Min=0, Max=150, Unit=" degC")  % Maximum Motor temperature threshold for drive mode to operate
c_VCU_EcuTempParkThd = Simulink.Parameter(70, StorageClass="ExportedGlobal", DataType="single", Min=0, Max=80, Unit=" degC")  % ECU temperature threshold for park mode to drive mode disable
c_VCU_EcuTempParkThdFlt = Simulink.Parameter(85, StorageClass="ExportedGlobal", DataType="single", Min=0, Max=100, Unit=" degC")  % ECU temperature threshold for park mode to Power off
c_VCU_EcuTempDrvThdMax = Simulink.Parameter(95, StorageClass="ExportedGlobal", DataType="single", Min=0, Max=150, Unit=" degC")  % Maximum ECU temperature threshold for drive mode to operate
s_VCU_VcuDrvMode = Simulink.Signal(StorageClass="ExportedGlobal", DataType="Enum: VCU_DRV_MODE")  % VCU Drive Modes (0:OFF, 1:NORMAL, 2:ECO, 3:SPORT, 4:TURBO)
Batt_Soc = Simulink.Signal(StorageClass="ExportedGlobal", DataType="Bus: UI8S")  % Battery Soc Value and Status
Veh_Speed_Snsr = Simulink.Signal(StorageClass="ExportedGlobal", DataType="Bus: F32S")  % Vehicle Speed Sensor Value and Status
c_VCU_BattSocDrvThd = Simulink.Parameter(10, StorageClass="ExportedGlobal", DataType="uint8", Min=5, Max=20, Unit="%")  % Minimum battery soc threshold for drive mode
c_VCU_BattSocLimpThd = Simulink.Parameter(5, StorageClass="ExportedGlobal", DataType="uint8", Min=0, Max=10, Unit="%")  % Minimum battery soc threshold for drive (limp) mode
s_vcu_park_flt_temp_b = Simulink.Signal(StorageClass="Localizable", DataType="boolean")
s_vcu_park_flt_curr_b = Simulink.Signal(StorageClass="Localizable", DataType="boolean")
s_vcu_batt_soc_low_b = Simulink.Signal(StorageClass="Localizable", DataType="boolean")
Thermal_Runway_B = Simulink.Signal(StorageClass="ExportedGlobal", DataType="boolean", Min=0, Max=1)  % Thermal Runway Flag
s_vcu_snsr_fail_b = Simulink.Signal(StorageClass="Localizable", DataType="boolean")
s_vcu_drv_on_b = Simulink.Signal(StorageClass="Localizable", DataType="boolean")
s_vcu_park_drv_disable_temp_b = Simulink.Signal(StorageClass="Localizable", DataType="boolean")
s_vcu_rev_butn_pressed_b = Simulink.Signal(StorageClass="Localizable", DataType="boolean")
s_vcu_drv_park_enable_b = Simulink.Signal(StorageClass="Localizable", DataType="boolean")
s_vcu_no_spd_b = Simulink.Signal(StorageClass="Localizable", DataType="boolean")
s_vcu_drv_limp_enable_b = Simulink.Signal(StorageClass="Localizable", DataType="boolean")
Throttle = Simulink.Signal(StorageClass="ExportedGlobal", DataType="Bus: UI8S")  % Throttle input value and status
Batt_Current = Simulink.Signal(StorageClass="ExportedGlobal", DataType="Bus: F32S")  % Battery current value and status
Brake_Sts_B = Simulink.Signal(StorageClass="ExportedGlobal", DataType="boolean", Min=0, Max=1)  % Brake Status (0: Not_Pressed, 1: Pressed)
Batt_Temp = Simulink.Signal(StorageClass="ExportedGlobal", DataType="Bus: F32S")  % Battery Temperature value and status
Motor_Temp = Simulink.Signal(StorageClass="ExportedGlobal", DataType="Bus: F32S")  % Motor Temperature value and status
ECU_Temp = Simulink.Signal(StorageClass="ExportedGlobal", DataType="Bus: F32S")  % Ecu Temperature value and status
Mode_Selection = Simulink.Signal(StorageClass="ExportedGlobal", DataType="Enum: MODE_SELECT")  % Mode Selection Button
Wheel_Slip_B = Simulink.Signal(StorageClass="ExportedGlobal", DataType="boolean")  % Wheel Slip flag
Standby_B = Simulink.Signal(StorageClass="ExportedGlobal", DataType="boolean")  % Standby flag
Seat_Lock_Sts_B = Simulink.Signal(StorageClass="ExportedGlobal", DataType="boolean")  % Seat Lock Status Flag
Reverse_Button_B = Simulink.Signal(StorageClass="ExportedGlobal", DataType="boolean")  % Reverse Button flag
s_vcu_batt_curr_fail_b = Simulink.Signal(StorageClass="Localizable", DataType="boolean")
s_vcu_drv_flt_temp_b = Simulink.Signal(StorageClass="Localizable", DataType="boolean")
s_vcu_drv_flt_b = Simulink.Signal(StorageClass="Localizable", DataType="boolean")
s_vcu_throt_val_zero_b = Simulink.Signal(StorageClass="Localizable", DataType="boolean")
s_vcu_batt_curr_thd_b = Simulink.Signal(StorageClass="Localizable", DataType="boolean")
s_VCU_DriveMode = Simulink.Signal(StorageClass="ExportedGlobal", DataType="Enum: VCU_DRV_MODE")  % VCU Drive Modes
s_VCU_ModeDisplay = Simulink.Signal(StorageClass="ExportedGlobal", DataType="Enum: VCU_DISPLAY")  % VCU Modes Display
s_vcu_snsr_critical_b = Simulink.Signal(StorageClass="Localizable", DataType="boolean")
s_VCU_DtcFlagEncoded = Simulink.Signal(StorageClass="ExportedGlobal", DataType="uint32")  % DTC flags encoded
s_VCU_PowerSts = Simulink.Signal(StorageClass="ExportedGlobal", DataType="Enum: POWER_MODE")  % VCU Power Mode Status (0: OFF, 1: ON)
s_vcu_vss_invalid_b = Simulink.Signal(StorageClass="Localizable", DataType="boolean")
s_vcu_batt_invalid_b = Simulink.Signal(StorageClass="Localizable", DataType="boolean")
s_vcu_throt_inavlid_b = Simulink.Signal(StorageClass="Localizable", DataType="boolean")
s_vcu_mot_temp_invalid_b = Simulink.Signal(StorageClass="Localizable", DataType="boolean")
s_vcu_ecu_temp_invalid_b = Simulink.Signal(StorageClass="Localizable", DataType="boolean")
s_vcu_rev_butn_actv_b = Simulink.Signal(StorageClass="Localizable", DataType="boolean")
s_vcu_mode_sts_dly = Simulink.Signal(StorageClass="Localizable", DataType="Enum: VCU_MODE")
c_VCU_DrvThdWait = Simulink.Parameter(100, StorageClass="ExportedGlobal", DataType="uint16", Min=0, Max=1000, Unit="10ms")  % Wait duration for Drive to Park jump when veh_spd is 0
c_VCU_ParkThdWait = Simulink.Parameter(100, StorageClass="ExportedGlobal", DataType="uint16", Min=0, Max=500, Unit="10ms")  % Wait duration for Wake Up to Park
c_VCU_FailSafeThdTime = Simulink.Parameter(200, StorageClass="ExportedGlobal", DataType="uint16", Min=0, Max=1000, Unit="10ms")  % Wait duration for Fail Safe Mode
c_VCU_ParkExtThdWait = Simulink.Parameter(100, StorageClass="ExportedGlobal", DataType="uint16", Min=0, Max=1000, Unit="10ms")  % Wait duration for Park Mode exit
throt_val_nonzero_b = Simulink.Signal(StorageClass="Localizable", DataType="boolean")
vcu_park_mode_b = Simulink.Signal(StorageClass="Localizable", DataType="boolean")

F32S = Simulink.Bus()
  Val: single
  Status: Enum: SIG_STATUS

UI8S = Simulink.Bus()
  Val: uint8
  Status: Enum: SIG_STATUS

batt_temp_invalid_b = Simulink.Signal(StorageClass="Localizable", DataType="boolean")
dtc_encoded_ui16_low = Simulink.Signal(StorageClass="Localizable", DataType="uint16")
dtc_encoded_ui16_high = Simulink.Signal(StorageClass="Localizable", DataType="uint16")
s_VCU_DisplayPwrSupply_B = Simulink.Signal(StorageClass="ExportedGlobal", DataType="boolean", Min=0, Max=1)  % Power Supply to Dashboard Display
s_VCU_MotPwrSupply_B = Simulink.Signal(StorageClass="ExportedGlobal", DataType="boolean", Min=0, Max=1)  % Power supply to motor control unit (mcu)
s_VCU_FrontLampReq_B = Simulink.Signal(StorageClass="ExportedGlobal", DataType="boolean", Min=0, Max=1)  % Request from VCU to turn ON the front lamp (presence/DRL)
c_VCU_FrontLampExclusive_B = Simulink.Parameter(0, StorageClass="ExportedGlobal", DataType="boolean", Min=0, Max=1)  % This calibration defines the control policy between the Front Lamp (presence/DRL) and the Headlamp (illumination).
Ambient_Light = Simulink.Signal(StorageClass="ExportedGlobal", DataType="uint16", Min=0, Max=1000, Unit="lx")  % Ambient light sensor (photodiode/LDR module).
c_VCU_BattCurrDrvTime = Simulink.Parameter(200, StorageClass="ExportedGlobal", DataType="uint16", Min=0, Max=1000, Unit="10ms")  % Time threshold for exeeding maximum continuous battery current for drive mode
HeadLamp_Manual_Switch_B = Simulink.Signal(StorageClass="ExportedGlobal", DataType="boolean", Min=0, Max=1)  % Rider‑operated manual switch input, TRUE = ON, FALSE = OFF.
c_VCU_HeadlampAutoEnable_B = Simulink.Parameter(1, StorageClass="ExportedGlobal", DataType="boolean", Min=0, Max=1)  % Enables automatic headlamp control via ambient sensor.
c_VCU_HeadlampManualOverride_B = Simulink.Parameter(1, StorageClass="ExportedGlobal", DataType="boolean", Min=0, Max=1)  % Manual switch can force headlamp ON regardless of ambient light.
c_VCU_HeadLampAmbientThd = Simulink.Parameter(300, StorageClass="ExportedGlobal", DataType="uint16", Min=0, Max=500, Unit="lx")  % Defines ambient light threshold below which headlamp is automatically requested ON.
s_VCU_HeadLampReq_B = Simulink.Signal(StorageClass="ExportedGlobal", DataType="boolean", Min=0, Max=1)  % Request from VCU to turn ON the headlamp based on ambient light threshold or manual switch.
vcu_power_on_b = Simulink.Signal(StorageClass="Localizable", DataType="boolean")
head_lamp_chk_b = Simulink.Signal(StorageClass="Localizable", DataType="boolean")
Push_Butn_B = Simulink.Signal(StorageClass="ExportedGlobal", DataType="boolean", Min=0, Max=1)  % Push Button for ignition
s_VCU_IgnOn_B = Simulink.Signal(StorageClass="ExportedGlobal", DataType="boolean", Min=0, Max=1)  % Ignition ON/OFF
push_butn_pressed_b = Simulink.Signal(StorageClass="Localizable", DataType="boolean")
c_VCU_LongPressTimeThd = Simulink.Parameter(200, StorageClass="ExportedGlobal", DataType="uint16", Min=0, Max=500, Unit="10ms")  % Defines the minimum press duration (in seconds) required for the push button to be considered a long press.
long_press_check_b = Simulink.Signal(StorageClass="Localizable", DataType="boolean")
butn_press_park_b = Simulink.Signal(StorageClass="Localizable", DataType="boolean")
butn_press_drv_b = Simulink.Signal(StorageClass="Localizable", DataType="boolean")
ign_on_b_dly = Simulink.Signal(StorageClass="Localizable", DataType="boolean")